# Grasshopper definition 1.0_print let's learn python.gh (Grasshopper 1.0.7)

# Print "let's learn Pyhton"
python = GhPythonScript()  # -> out, a
# ---------- python: Python ----------
print "let's learn Python"
# ---------- end python ----------
