# Grasshopper definition 1.1_Variables.gh (Grasshopper 1.0.7)

# Variables
python = GhPythonScript()  # -> out, YourAge, Add, OtherName
# ---------- python: Python ----------
#Variables / Placeholders 

#Integers 
SomeNumber = 20 
YourAge = 20+30


#Floats / Numbers+ fractional part
FloatNumber = 14.55
Add = YourAge + FloatNumber
print type(Add)


#Strings / Text
MyName = "Lily"
YouName = 'Leo'
Example = "The world's perfect"
OtherName = MyName + YouName

#Boleans   True / False
True
False
# ---------- end python ----------
panel = Panel(python.OtherName)
