# Grasshopper definition 1.2_Operators.gh (Grasshopper 1.0.7)

# Comparison Operators
python = GhPythonScript()  # -> out, a
# ---------- python: Python ----------
#Operators

#2 Comparison/Relational Operators

a = 3
b = 5
c = 3

a == c
b != c
a < b
b > c
# >=
# <=
# ---------- end python ----------
# Arithmetic Operators
python_2 = GhPythonScript()  # -> out, a
# ---------- python_2: Python ----------
# Operators

#1 + 4 = 5 

#1     Arithmetic Operators 

x = 3
#      +  Addition        x + 2 = 5
#      -  Subtraction     x - 2 = 1
#      *  Multiplication  x * 4 = 12 
#      /  Division        x / 3 = 1
#      %  Modulus         x % 3 = 0
#      ** Exponent        x **2 = 9
# ---------- end python_2 ----------
