# Grasshopper definition 2.1_Conditionals.gh (Grasshopper 1.0.7)

python = GhPythonScript()  # -> out, a
# ---------- python: Python ----------
#Conditional Statements

Shopping_List=["Apple" , "Orange" , "Kiwi"]

if "Apple" in Shopping_List : #True
    print "Apple is here!"

if "Banana" in Shopping_List : #false
    print "Banana is here!"
else :
    print"banana is not in Shopping_list!"
# ---------- end python ----------
python_2 = GhPythonScript(x=Slider(32, range=0..100))  # -> out, a; inputs x: Int32
# ---------- python_2: Python ----------
if x==10:
    print"x is 10 "
elif x==20 :
    print"x is 20"
elif x==30:
    print"x is 30 "
else:
    print " it is not 10 / 20 / 30"
# ---------- end python_2 ----------
python_3 = GhPythonScript(y=Slider(5, range=0..10))  # -> out; inputs y: Int32
# ---------- python_3: Python ----------
if  y %2 == 0:
    print"y is even number"
else :
    print"y is odd number"
# ---------- end python_3 ----------
panel = Panel(python.out)
panel_2 = Panel(python_2.out)
panel_3 = Panel(python_3)
