# Grasshopper definition 2.2_For Loop.gh (Grasshopper 1.0.7)

# for loop
python = GhPythonScript()  # -> out, a
# ---------- python: Python ----------
#Loops

list = [1, 2 ,3]

for i in list:
    print i

for letter in "English":
    print 'the letter is' , letter
# ---------- end python ----------
python_2 = GhPythonScript()  # -> out, a
# ---------- python_2: Python ----------
#range
print range(10)
print range(10,20)
print range(10,26 , 5)
# ---------- end python_2 ----------
python_3 = GhPythonScript()  # -> out, a
# ---------- python_3: Python ----------
names=["Lilly" , "Jack" , "Tommy"]

#[0,1,2]

for a in range(len(names)):
    print "my name is " , names[a]
# ---------- end python_3 ----------
python_4 = GhPythonScript()  # -> out, a
# ---------- python_4: Python ----------
list_1 = [10,20,30]

for number in list_1 :
    print (number + 5)
# ---------- end python_4 ----------
python_5 = GhPythonScript()  # -> out, a
# ---------- python_5: Python ----------
for i in range(21):
    print i , str(i)
# ---------- end python_5 ----------
panel = Panel(python_2.out)
panel_2 = Panel(python_5.out)
panel_3 = Panel(python_4.out)
panel_4 = Panel(python.out)
panel_5 = Panel(python_3.out)
range = Range(Domain="10 to 20", Steps=Slider(5, range=0..10))
panel_6 = Panel(range)
