# Grasshopper definition 2.3_While Loops.gh (Grasshopper 1.0.7)

# 1.1.7_While Loops
python = GhPythonScript()  # -> out, a, b
# ---------- python: Python ----------
#While loops

while True : #True Forever
    print "a"
    break


a=10

while a<20: #true
    print a , "is smaller than 20"
    a = a+1
# ---------- end python ----------
panel = Panel(python.b)
