# Grasshopper definition 3.1_Functions.gh (Grasshopper 1.0.7)

python = GhPythonScript(number1=Slider(31, range=0..100), number2=Slider(36, range=0..100))  # -> out, a; inputs number1: Int32, number2: Int32
# ---------- python: Python ----------
def odd_even(i , j):
    if  i%2 ==0 and j%2==0 :
        print " i & j are even"
    elif i % 2!= 0 and j%2 != 0 :
        print " i & j are odd"
    elif i%2 ==0 and j%2 != 0:
        print "i is even but j is odd"
    else:
        print "i is odd but j is even"

odd_even(number1 , number2)
# ---------- end python ----------
python_2 = GhPythonScript()  # -> out, a
# ---------- python_2: Python ----------
#Functions

def lily():
    print"Python"


print"10"
lily()
print"12"


def multi(a , b):
    print a*20 + b**3

multi(2 ,3)
# ---------- end python_2 ----------
