# Grasshopper definition 3.2_Function(Fibonacci).gh (Grasshopper 1.0.7)

# 1.1.9_Function(Fibonacci)
python = GhPythonScript(x=Slider(10, range=0..10))  # -> out, a; inputs x: Int32
# ---------- python: Python ----------
# Fibonacci Function

def fib(n):
    if n==0:
        return 0
    if n==1:
        return 1
    else:
        return fib(n-2)+ fib(n-1)

a = fib(x)
# ---------- end python ----------
panel = Panel(python.a)
pt = ConstructPoint(XCoordinate=python.a, YCoordinate=python.a, ZCoordinate=python.a)
rec = DataRecorder(pt, DataLimit=-10, RecordData=True)
pline = PolyLine(Vertices=rec, Closed=False)
