# Grasshopper definition 4.1_Points.gh (Grasshopper 1.0.7)

python = GhPythonScript()  # -> out, all_pts, pl
# ---------- python: Python ----------
import rhinoscriptsyntax as rs

all_pts = []
for j in range(30):
    if j %2 == 0 :
        pts = rs.AddPoint(j , 4, 0)
    else :
        pts = rs.AddPoint(j, 14 , 0)
    all_pts.append(pts)
    pl = rs.AddPolyline(all_pts)
# ---------- end python ----------
python_2 = GhPythonScript()  # -> out, a, b, c, points, d
# ---------- python_2: Python ----------
import rhinoscriptsyntax as rs

a = rs.AddPoint(10, 4 , 7)

points = []
for i in range (20):
    b = rs.AddPoint(i , 0 , 0)
    points.append(b)

d=rs.AddPolyline(points, None)

c = 0
c = 1
# ---------- end python_2 ----------
nurbs = NurbsCurve(Vertices=python.all_pts, Degree=3, Periodic=False)  # -> Curve, Length, Domain
pt = Point(python_2.points)
python_3 = GhPythonScript()  # -> out, a
# ---------- python_3: Python ----------
import rhinoscriptsyntax as rs
import math


a= rs.AddPoint(math.sin(90),math.cos(60))
# ---------- end python_3 ----------
panel = Panel(pt)
panel_2 = Panel(python_3.a)
pipe = Pipe(Curve=nurbs.Curve, Radius=Slider(0.4, range=0..1), Caps=2)
preview = CustomPreview(Geometry=pipe, Material=ColourSwatch(SwatchColor=RGB(56, 212, 255)))
