# Grasshopper definition 4.2_GridPoints.gh (Grasshopper 1.0.7)
# plug-ins: Weaverbird

number_slider = Slider(100, range=0..100)
python = GhPythonScript(x=number_slider, y=number_slider, v=Slider(0.99, range=0..10), n=Slider(5.95, range=0..10))  # -> out, a; inputs x: Int32, y: Int32
# ---------- python: Python ----------
import rhinoscriptsyntax as rs
import math

a=[]
for i in range(x):
    for j in range(y):
        a.append(rs.AddPoint(i , j ,(math.sin(i*n)* math.cos(j*n))* v))
# ---------- end python ----------

del = DelaunayMesh(Points=python.a, Plane=PlaneXY(0, 0, 0))
wbstellate = WeaverbirdsStellateCumulation(MeshPolylines=del, Distance=5)
preview = CustomPreview(Geometry=wbstellate, Material=ColourSwatch(SwatchColor=RGB(74, 168, 98)))

wbwindow = WeaverbirdsMeshWindow(MeshPolylines=del, Distance=5, InsetType=0)
