# Grasshopper definition 5.1_Divide_Curve.gh (Grasshopper 1.0.7)

crv = Curve(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)
crv_2 = Curve(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)
crv_3 = Curve(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)
python = GhPythonScript(line1=crv, line2=crv_2, line3=crv_3)  # -> out, a, b, c, d, ln1, ln2; inputs line1: Curve, line2: Curve, line3: Curve
# ---------- python: Python ----------
import rhinoscriptsyntax as rs

a = rs.DivideCurve(line1,20)
b = rs.DivideCurve(line2,20)
c= rs.DivideCurve(line3 , 20)
#c =rs.AddLine(a[0],b[0])
#d =rs.AddLine(a[1],b[1])

ln1=[]
ln2=[]
for i in range(21):
    f = rs.AddLine(a[i],b[i])
    g =rs.AddLine(b[i],c[i])
    ln1.append(f)
    ln2.append(g)
# ---------- end python ----------
pipe = Pipe(Curve=[python.ln1, python.ln2, crv, crv_2, crv_3], Radius=Slider(3.4, range=0..10), Caps=2)
panel = Panel(python.a)
