# Grasshopper definition 5.3_Rotation.gh (Grasshopper 1.0.7)

# ----
# the points are internalized :)
pt = Point(Point(26.72661207, 5.183599974, 0))
pt_2 = Point(Point(22.31960991, 2.72883632, 0))

python = GhPythonScript(pt1=pt, pt2=pt_2, p=Slider(37, range=0..100))  # -> out, pt3, pt4, ln1, ln2, ln3, ln4, a, b; inputs pt1: Point3d, pt2: Point3d, p: Int32
# ---------- python: Python ----------
import rhinoscriptsyntax as rs
import math
#pt =(4,6,7)

#pt1
#pt2
#pt3
#pt4

pt3 = rs.AddPoint(pt1[0],pt2[1],0)
pt4 = rs.AddPoint(pt2[0],pt1[1],0)

#ln1 = rs.AddLine(pt1,pt3)
#ln2 = rs.AddLine(pt2,pt4)
#ln3=  rs.AddLine(pt3,pt2)
#ln4 = rs.AddLine(pt4,pt1)

pts = [pt1 , pt3 , pt2 , pt4 , pt1]

a=[]
for i in range(4):
    a.append( rs.AddLine(pts[i],pts[i+1]))


b =[]
curves = []
for j in range(300):
    curves.append(rs.JoinCurves(a , False , None))
    b.append(rs.RotateObject(curves, pt3 , math.degrees(j*p), None , True))
# ---------- end python ----------
