# Grasshopper definition 6.2_Spiral.gh (Grasshopper 1.0.7)

python = GhPythonScript(it=Slider(534, range=0..1000), v=Slider(1000, range=0..1000), n=Slider(0.1, range=0..1), f=Slider(0.1, range=0..1))  # -> out, a; inputs it: Int32, v: Int32
# ---------- python: Python ----------
import rhinoscriptsyntax as rs
import math

a =[]
for i in range(it):
    x = math.cos(i*0.1) * i * n
    y = math.sin(i*0.1) * i * f
    
    if (i < v):
        z = i* 0.05
    p = rs.AddPoint(x , y , z) 
    a.append(p)
# ---------- end python ----------
pline = PolyLine(Vertices=python.a, Closed=False)
# Go with your favourit color!! :)
pipe = Pipe(Curve=pline, Radius=Slider(1, range=0..10), Caps=2)
preview = CustomPreview(Geometry=pipe, Material=ColourSwatch(SwatchColor=RGB(84, 227, 255)))
