# Grasshopper definition 6.3_Koch snowflake.gh (Grasshopper 1.0.7)

point = Point(<point referenced from the Rhino model>)
point_2 = Point(<point referenced from the Rhino model>)
ghpython_script = GhPythonScript(x=point, y=point_2, t=Slider(4, range=0..10))  # -> out, a, templine; inputs x: Point3d, y: Point3d, t: Int32
# ---------- ghpython_script: Python ----------
import rhinoscriptsyntax as rs
from math import sin, pi

def getnormal(x):
    spt = rs.CurveStartPoint(x)
    ept = rs.CurveEndPoint(x)
    midx = ept[0] - spt[0]
    midy = ept[1] - spt[1]
    vector =
# ---------- end ghpython_script ----------

# ----
# done in grasshopper
polygon = Polygon(Plane=PlaneXY(0, 0, 0), Radius=3, Segments=Slider(3, range=0..10), FilletRadius=0)  # -> Polygon, Length
debrep = DeconstructBrep(Brep=polygon.Polygon)  # -> Faces, Edges, Vertices
item = ListItem(List=debrep.Vertices, Index=0, Wrap=True)  # -> Item, Item1, Item2

# ----
# Move object example
number_slider = Slider(0, range=0..100)
X = UnitX(Factor=number_slider)
pt = Point(Point(15.75579394, -14.37609785, 0))
move = Move(Geometry=pt, Motion=X)  # -> Geometry, Transform

# ----
# Koch geometry explanation
panel = Panel("sin (60) = x/ l")
panel_2 = Panel("x = sin(60) * l")

pt_2 = Point(item.Item)
pt_3 = Point(item.Item1)
pt_4 = Point(item.Item2)
python = GhPythonScript(x=pt_2, y=pt_3, z=pt_4, it=Slider(0, range=0..10))  # -> out, a; inputs x: Point3d, y: Point3d, z: Point3d, it: Int32
# ---------- python: Python ----------
import rhinoscriptsyntax as rs
import math


klines=[rs.AddLine(y,x) , rs.AddLine(z,y) , rs.AddLine(x,z)]

def normal_vec(x):
    sPt = rs.CurveStartPoint(x)
    ePt = rs.CurveEndPoint(x)
    midx = ePt[0]-sPt[0]
    midy = ePt[1]-sPt[1]
    vector = [-midy,midx,0]
    return rs.VectorUnitize(vector)


def koch(linelist , it):
    sample_ln = linelist[:]
    lines=[]
    
    if it==0:
        return sample_ln
    else :
        for i in sample_ln:
            length = rs.CurveLength(i)
            midpt= rs.CurveMidPoint(i)
            pts = rs.DivideCurve(i,3)
            vector = normal_vec(i)
            h=math.sin(math.pi/3) * length/3
            pts.insert(2,rs.MoveObject(midpt,vector*h))
            segment = rs.ExplodeCurves(rs.AddPolyline(pts))
            lines +=segment
            
    it -= 1
    
    return koch(lines , it)


a = koch(klines,it)
# ---------- end python ----------
pipe = Pipe(Curve=python.a, Radius=Slider(0.04, range=0..0.1), Caps=0)
